# Grasshopper definition SDMMinSurf.ghx (Grasshopper 0.9.76)
# plug-ins: MeshEdit Components, Python Interpreter, TT Toolbox

# ---- group: Options
panel = Panel("gradient")
panel_2 = Panel("fixed-point")
# Options
number_slider = Slider(1, range=0..100)
q_cables = Slider(1000, range=0..10000)
toggle = BooleanToggle(True)
toggle_2 = BooleanToggle(True)
max_disp = Slider(0.001, range=0..0.1)
number_slider_2 = Slider(0, range=0..0.01)
panel_3 = Panel("seidel")
pressure = Slider(0, range=-10..100)
# Inputs
density = Slider(5, range=-10..100)
cables = Curve([<curve referenced from the Rhino model> x5])
max_iter = Slider(100, range=0..1000)
number_slider_3 = Slider(4, range=0..10)
number_slider_4 = Slider(1, range=0..1)
pt = Point(<point referenced from the Rhino model>)
mesh = Mesh(<mesh referenced from the Rhino model>)

# ---- group: Analytically generated PH for comparison
côté_carré = Slider(100, range=0..100)
hauteur = Slider(50, range=0..100)
N = Steps(100)
division = Division(A=côté_carré, B=2)
neg = Negative(Value=division)
multiplication = Multiplication(A=division, B=côté_carré)
# Mathematical Solution
dom = ConstructDomain(DomainStart=neg, DomainEnd=division)
range = Range(Domain=dom, Steps=N)
division_2 = Division(A=multiplication, B=hauteur)
multiplication_2 = Multiplication(A=graft(range), B=reverse(range))
division_3 = Division(A=multiplication_2, B=division_2)
pt_2 = ConstructPoint(XCoordinate=graft(range), YCoordinate=reverse(range), ZCoordinate=division_3)  # -> flatten(Point)
addition = Addition(A=N, B=1)
srfgrid = SurfaceFromPoints(Points=pt_2, UCount=addition, Interpolate=False)

# ----
panel_4 = Panel("""2000
2000
2000
2000
1000""")

# ---- group: Build Problem
cmv = PythonScript(mesh=mesh, points=pt)  # -> fixed; inputs points: list
# ---------- cmv: Python ----------
"""Wrapper component for the meshminimizehelpers.mesh_close_vertices()
method.
"""

from meshminimizehelpers import mesh_closest_vertices

fixed = mesh_closest_vertices(mesh, points)
# ---------- end cmv ----------
sdm_edges = PythonScript(mesh=mesh, fixed_cable_ends=toggle)  # -> SDMEdges; inputs fixed: list, cables: list of Curve, q_cables: list
# ---------- sdm_edges: Python ----------
"""
Wrapper block for defining the edges of the problem: cables and fixed-points
"""

import rhinoscriptsyntax as rs
import meshminimizehelpers as mmh

class SDMEdges:
    """
    Emulates a custom type for the edges of the problem
    """
    
    def __init__(self, cables, q_cables, vertices, naked, fixed):
        """
        Initiate cables and edges with dedicated method from meshminimize
        """
        self.cables = cables
        self.q_cables = q_cables
        (self.ql, self.n_cable, self.fixed) = mmh.define_cables(cables, q_cables,
                                                        vertices, naked, fixed)
        
    def __str__(self):
        """Simple display for error checking"""
        str = ''
        for key in self.__dict__:
            str += "%s: %s\n" % (key, self.__dict__[key])
        return str
        
"""Create default fixed points parameter"""
if not fixed:
    if not cables:
        #Edges are fixed when no cables are defined
        fixed = rs.MeshNakedEdgePoints(mesh)
    else:
        # Fixed points will be defined by mm.define_cables, initialize to
        # none fixed
        fixed = [False for i in rs.MeshVertices(mesh)]
        
"""Create default cables density parameter"""
if not q_cables:
    #Default: 1
    q_cables = [1 for i in cables]
elif len(q_cables) == 1:
    #Allows to pass in one number for all cables
    q_cables = [q_cables[0] for i in cables]
        
        
SDMEdges = SDMEdges(
                cables,
                q_cables,
                rs.MeshVertices(mesh),
                rs.MeshNakedEdgePoints(mesh),
                fixed
                )
# ---------- end sdm_edges ----------
sdm_options = PythonScript(
    save_results=toggle_2,
    max_disp=max_disp,
    max_iter=max_iter,
    max_iter_qs=number_slider_3,
    max_dev_sigma=number_slider_2,
    speed=number_slider_4,
    method=panel_3,
    pressure=pressure,
    density=density)  # -> options; inputs max_iter: Int32
# ---------- sdm_options: Python ----------
"""
Block externalizing options for the solver
"""

class SDMOptions:
    """
    Emulates a custom type to pass the options to the solver
    """
    
    def __init__(self, max_disp, max_iter, max_iter_qs, max_dev_sigma, speed,
                 method, pressure, density):
        self.save_results = save_results
        self.max_disp = max_disp
        self.max_iter = max_iter
        self.max_iter_qs = max_iter_qs
        self.max_dev_sigma = max_dev_sigma
        self.speed = speed
        self.method = method
        self.pressure = pressure
        self.density = density
        
    def __str__(self):
        """Simple display for error checking"""
        str = ''
        for key in self.__dict__:
            str += "%s: %s\n" % (key, self.__dict__[key])
        return str
            
options = SDMOptions(max_disp, max_iter, max_iter_qs, max_dev_sigma, speed,
                     method, pressure, density)
# ---------- end sdm_options ----------
# Solver
sdm_problem = PythonScript(mesh=mesh, q_faces=number_slider, SDMEdges=sdm_edges)  # -> SDMMesh; inputs mesh: Mesh, q_faces: list
# ---------- sdm_problem: Python ----------
"""
Block for outsourcing the mesh problem definitions
"""

import rhinoscriptsyntax as rs
import copy

class SDMMesh:
    """
    Emulates a custom type to pass the mesh problem to the solver
    """
    
    def __init__(self, mesh, SDMEdges, q_faces, reference):
        self.cables = SDMEdges.cables
        self.fixed = SDMEdges.fixed
        self.q_faces = copy.deepcopy(q_faces)
        self.ql = SDMEdges.ql
        self.q_cables = SDMEdges.q_cables
        self.n_cable = SDMEdges.n_cable
        self.mesh = mesh
        self.reference = reference
        
    def __str__(self):
        """Simple display for error checking"""
        str = ''
        for key in self.__dict__:
            str += "%s: %s\n" % (key, self.__dict__[key])
        return str
        
        
#Create defaults (1) for the surface density
if not q_faces:
    q_faces = [1 for i in range(rs.MeshFaceCount(mesh))]
elif len(q_faces) == 1:
    q_faces = [q_faces[0] for i in range(rs.MeshFaceCount(mesh))]
print q_faces
#Create defaults (current mesh) for the reference mesh
if not reference: reference = rs.MeshVertices(mesh)

SDMMesh = SDMMesh(mesh, SDMEdges, copy.deepcopy(q_faces), reference)
# ---------- end sdm_problem ----------
sdm_solver = PythonScript(toggle=Toggle(True), SDMMesh=sdm_problem, SDMCables=sdm_edges, options=sdm_options)  # -> mesh_out, displacements, F_membrane, F_cable, F_pressure, F_gravity, stresses, convergence; inputs toggle: Boolean, SDMCables: list
# ---------- sdm_solver: Python ----------
#!/usr/bin/env python
# -*- coding: utf-8 -*-

"""
Wrapper block encapsulating the meshminimize module
"""

import meshminimize as mm
import rhinoscriptsyntax as rs
import ghpythonlib.components as ghcomp
import copy
from imp import reload
reload(mm)

#Pass options to the MeshMinimize module
for key in options.__dict__:
    if key not in ('pressure', 'density'):
        mm.__dict__[str.upper(key)] = options.__dict__[key]

if toggle:
        vertices, out = mm.minimize_mesh(
                        SDMMesh.mesh,
                        SDMMesh.cables, 
                        fixed=SDMMesh.fixed, 
                        qs=copy.deepcopy(SDMMesh.q_faces),
                        q_cables=SDMMesh.q_cables, 
                        reference=SDMMesh.reference, 
                        ql=SDMMesh.ql, 
                        n_cable=SDMMesh.n_cable,
                        P=options.pressure,
                        G=options.density
                        )
else:
    vertices = rs.MeshVertices(SDMMesh.mesh)
    

mesh_out = rs.AddMesh(vertices, rs.MeshFaceVertices(SDMMesh.mesh))

displacements = [rs.VectorCreate(v1, v2) for (v1, v2) in zip(rs.MeshVertices(SDMMesh.mesh), vertices)]

F_membrane = out['M']
F_cable = out['C']
F_pressure = out['P']
F_gravity = out['G']
stresses = out['S']
convergence = out['convergence']
# ---------- end sdm_solver ----------

# ---- group: Raw Inputs
check_options = Panel(sdm_options)
check_problem = Panel(sdm_problem)

# ---- group: Compare with mathematical solution
mesh_2 = Mesh(sdm_solver.mesh_out)
demesh = DeconstructMesh(Mesh=mesh_2)  # -> Vertices, Faces, Colours, Normals
srf_cp = SurfaceClosestPoint(Point=demesh.Vertices, Surface=srfgrid)  # -> Point, UVPoint, Distance
sqr = Square(Value=srf_cp.Distance)
bnd = Bounds(Numbers=sqr)
# Display
dedomain = DeconstructDomain(Domain=bnd)  # -> Start, End
max_error = Panel(dedomain.End)

# ----
number_slider_5 = Slider(0, range=0..100)
repeat = RepeatData(Data=graft([Slider(0, range=0..100), number_slider_5]), Length=max_iter)
series = Series(Start=1, Step=1, Count=max_iter)  # -> simplify(graft(Series))
flip = FlipMatrix(Data=repeat)  # -> simplify(Data)
path = ConstructPath(Indices=[flip, series])
path_mapper = PathMapper(sdm_solver.F_cable, source="{A;B;C}", target="{A;C;B}")
branch = TreeBranch(Tree=path_mapper, Path=path, MaintainPaths=True)
panel_5 = Panel(branch)

# ---- group: Raw Outputs
convergence_criterion = Panel(sdm_solver.convergence)
graph = QuickGraph(convergence_criterion)
lng = ListLength(List=convergence_criterion)
# Outputs
iterations_count = Panel(lng)
stresses = Panel(sdm_solver.stresses)

# ---- group: Displacements
demesh_2 = DeconstructMesh(Mesh=mesh)  # -> Vertices, Faces, Colours, Normals
vec = Vector(sdm_solver.displacements)
dprod = DotProduct(VectorA=demesh_2.Normals, VectorB=vec, Unitize=False)
vlen = VectorLength(Vector=vec)
bnd_2 = Bounds(Numbers=dprod)
bnd_3 = Bounds(Numbers=vlen)
displacement_along_normal_final_mesh = Panel(bnd_2)
displacement_length = Panel(bnd_3)

# ---- group: Raw Outputs (continued)
displacements = Panel(vlen)

# ----
item = ListItem(List=vec, Index=number_slider_5, Wrap=True)
item_2 = ListItem(List=demesh_2.Vertices, Index=number_slider_5, Wrap=True)

# ---- group: Displacements (continued)
vdis = VectorDisplay(Anchor=item_2, Vector=expr("-x", item))

# ---- group: Colorize output based on stresses
bnd_4 = Bounds(Numbers=sdm_solver.stresses)
medges = MeshEdges(Mesh=sdm_solver.mesh_out)  # -> NakedEdges, InteriorEdges, NonManifoldEdges
dedomain_2 = DeconstructDomain(Domain=bnd_4)  # -> Start, End
expression = Expression(x=dedomain_2.Start, y=dedomain_2.End, Expression="If(abs(x-y)<1, y+1, y)")
expression_2 = Expression(x=dedomain_2.Start, y=expression, Expression="(y-x)/4*.99")
series_2 = Series(Start=dedomain_2.Start, Step=expression_2, Count=5)
gradient = Gradient(
    LowerLimit=dedomain_2.Start,
    UpperLimit=expression,
    Parameter=sdm_solver.stresses,
    stops=[0.249: RGB(255, 0, 0), 0.503: RGB(255, 255, 0), 0.755: RGB(0, 255, 0)])
explode = MeshExplode(Mesh=sdm_solver.mesh_out, Interpolate=False)
mcol = MeshColours(Mesh=graft(explode), Colours=graft(gradient))

# ----
split = SplitList(List=series_2, Index=1)  # -> ListA, ListB

# ---- group: Colorize output based on stresses (continued)
gradient_2 = Gradient(
    LowerLimit=dedomain_2.Start,
    UpperLimit=expression,
    Parameter=split.ListB,
    stops=[0.249: RGB(255, 0, 0), 0.503: RGB(255, 255, 0), 0.755: RGB(0, 255, 0)])
stepped_colour_legend = SteppedColourLegend(Colours=gradient_2, Start=dedomain_2.Start, End=expression, Title="Stresses", Description=" ")
